# Grasshopper definition MinimalPhysX.gh (Grasshopper 1.0.7)
# plug-ins: PhysX.GH

# Step 3: Run Simulation
number_slider = Slider(20, range=0..100)
# Run
toggle = BooleanToggle(True)
# Reset
button = Button()
# Step 2: Create PhysX Objects
number_slider_2 = Slider(0.235, range=0..1)
point = Point(Point(0, 0, -1))
# Click To Import (Clean WorkSpace First)
# Step 1: Import ,Obj From Files
import_obj = GhPythonScript()  # -> graft(MeshPath), Boundary, Structure
# ---------- import_obj: Python ----------
__author__ = "ziqwang"
__version__ = "2018.12.19"

import rhinoscriptsyntax as rs
import xml.etree.ElementTree as ET
import os

file_name = ghenv.Component.OnPingDocument().FilePath
FolderPath =  os.path.dirname(file_name)
FolderPath =  os.path.abspath(os.path.join(FolderPath, os.pardir))
XMLPath = FolderPath + "\MergePartGroup.xml"

tree = ET.parse(XMLPath)
root = tree.getroot()
node_groups = root.find("MergePartGroup")

MeshPath = []
Boundary = []
Structure = []
NumPart = 0
for node_group in node_groups.iter("Group"):
    partIDs = [int(x) for x in node_group.text.split(",")]
    NumPart += len(partIDs)
    if node_group.attrib['type'] != "Boundary":
        Structure.append(partIDs)
    else:
        Boundary.append(partIDs)

for partID in range(NumPart):
    MeshPath.append(FolderPath + "\Simulation\Part_" + str(partID) + ".obj")
print Structure
# ---------- end import_obj ----------
# Here Set Mesh
mesh = Mesh([<mesh referenced from the Rhino model> x103])
scale = Scale(Geometry=mesh, Center=point, Factor="10")  # -> Geometry, Transform
px_mat = PXMaterial(StaticFriction=0.5, DynamicFriction=0.5, Restitution=number_slider_2)
create_physx = GhPythonScript(material=px_mat, Boundary=import_obj.Boundary, Structure=import_obj.Structure, Mesh=scale.Geometry)  # -> fixed, merge, animate; inputs Structure: list, Mesh: list of Mesh
# ---------- create_physx: Python ----------
__author__ = "ziqwang"
__version__ = "2018.12.19"

import rhinoscriptsyntax as rs
import ghpythonlib.components as gh
import xml.etree.ElementTree as ET
import os
from System import Object
from Grasshopper import DataTree
from Grasshopper.Kernel.Data import GH_Path

def raggedListToDataTree(raggedList):
    rl = raggedList
    result = DataTree[object]()
    for i in range(len(rl)):
        temp = []
        for j in range(len(rl[i])):
            temp.append(rl[i][j])
        #print i, " - ",temp
        path = GH_Path(i)
        result.AddRange(temp, path)
    return result

fixed = []
animate = []
merge = []
for partIDs in Structure:
    print partIDs
    if len(partIDs) == 1:
        mesh = Mesh[partIDs[0]]
        output = gh.PhysX.PXConvexMesh(mesh, True, material)
        animate.append(output)
    else:
        group = gh.ListItem(Mesh, partIDs, True)
        group = gh.Group(group)
        merge.append(group)
for m in Boundary:
    mesh = Mesh[m]
    fixed.append(gh.PhysX.PXConvexMesh(mesh, False, material))
# ---------- end create_physx ----------
merge = GhPythonScript(x=graft(create_physx.merge))  # -> a
# ---------- merge: Python ----------
__author__ = "ziqwang"
__version__ = "2018.12.19"

import rhinoscriptsyntax as rs

a = x
# ---------- end merge ----------
read_mesh = ReadMesh(filename=import_obj.MeshPath, button=Button())
group = Group(Objects=merge)  # -> flatten(Group)
# Unlink here If no part is merged
px_compoconvexmesh = PXCompoConvexMesh(Dynamic=True, MaterialProperty=px_mat)
px_simulate = PXSimulate(
    RigidBodies=[create_physx.fixed, px_compoconvexmesh, create_physx.animate],
    Gravity="0,0,-9.8",
    Timestep=0.01,
    Steps=number_slider,
    Reset=button,
    Run=toggle)  # -> Info, Dynamics, Statics
lng = ListLength(List=[px_simulate.Dynamics, px_simulate.Statics])
range = Range(Domain=Domain(0, 255), Steps=expr("x-1", lng))
gradient = Gradient(
    LowerLimit=0,
    UpperLimit=255,
    Parameter=range,
    stops=[0: RGB(234, 38, 0), 0.25: RGB(234, 126, 0), 0.5: RGB(254, 244, 84), 0.75: RGB(173, 203, 249), 1: RGB(75, 107, 169)])
face_boundaries = FaceBoundaries(Mesh=[px_simulate.Statics, px_simulate.Dynamics])
preview = CustomPreview(Geometry=[px_simulate.Dynamics, px_simulate.Statics], Shader=gradient)

# ==== cluster ReadMesh
filename = ClusterInput()
button = ClusterInput()
ghpython_script = GhPythonScript(filename=filename, button=button)
# ---------- ghpython_script: Python ----------
__author__ = "ziqwang"
__version__ = "2018.12.19"

import rhinoscriptsyntax as rs
import Rhino as rh
import ghpythonlib.components as gh

if button:
    doc = rh.RhinoDoc.ActiveDoc
    op = rh.FileIO.FileReadOptions()
    options = rh.FileIO.FileObjReadOptions(op)
    options.MapYtoZ = True
    rh.FileIO.FileObj.Read(filename, doc, options)
# ---------- end ghpython_script ----------
